vi "index.gviweb"   [LabVIEW NXG 3.1.0]
panel controls:
  "Ordem de serviço": string
  "Ferramenta 1": string
  "Temperature 1": f64
  "Temperature 2": f64
  "Get Ordem de serviço": bool
  "Get Ordem de serviço_2": bool
uses:
  NI::HTTP::GET.gvi
diagram:
  # Place setup code before the loop. For example, perform initial data communication and wire the results into the loop.
  # Top-Level WebVIs usually contain a While Loop that never stops so that they can continue running as long as the web page is open in the user's web browser.
  while {
    event {
      on "Get Ordem de serviço" Value changed {
        call "GET.gvi"(url="http://10.48.0.67:8001/WebService/ServiceOrderQRcode_(Get)") -> (body=w1, error out=w2)
        disable {
          frame Enabled {
            w3 = w1
          }
          frame Disabled {
            Unflatten From JSON(JSON string=w1, error in (no error)=w2, type and defaults=cluster{"String Constant": string} {all zero or empty}) -> (value=w4)
            Property Node(instance in=w4) -> ("String Constant"=w3)
          }
        }
        $"Ordem de serviço" <- w3
      }
      on "Ferramenta 1" Value changed {
        disable {
          frame Enabled { }
          frame Disabled {
            call "GET.gvi"() -> (body=w5, error out=w6)
            Unflatten From JSON(JSON string=w5, error in (no error)=w6, type and defaults=cluster{"String Constant": string} {all zero or empty}) -> (value=w7)
            Property Node(instance in=w7) -> ("String Constant"=w8)
            $"Ferramenta 1" <- w8
          }
        }
      }
    }
    Wait(time to wait=50)
    stop if FALSE
  }
